# Grasshopper definition RosGhUnity.gh (Grasshopper 1.0.7)
# plug-ins: Heteroptera, Robots

# ---- group: IP of ROS PC running rosbridge_server
panel = Panel("ws://192.168.1.35:9090")

# ----
button = Button()
timer = Timer(TimerInterval=500, Target=[websocket_client_receiver, websocket_client_receiver_4, websocket_client_receiver_5])

websocket_client_start = WebsocketClientStart(Address=panel, InitalMessage="Hello World", Reset=button)
subscribe = Subscribe(Topic="/pose_Tracker")  # -> R
# ---------- subscribe: Python ----------
import json


data = {
"op":"subscribe",
"topic":Topic
}

R = json.dumps(data)
# ---------- end subscribe ----------
websocket_client_receiver = WebsocketClientReceiver(WebsocketObjects=websocket_client_start, AutoUpdate=Toggle(False))  # -> Message, Status
websocket_client_sender = WebsocketClientSender(WebsocketObjects=websocket_client_start, Message=subscribe)
panel_2 = Panel(websocket_client_receiver.Message)

websocket_client_start_2 = WebsocketClientStart(Address=panel, InitalMessage="Hello World", Reset=button)
subscribe_2 = Subscribe(Topic="/pose_BaseStation1")  # -> R; same code as subscribe
websocket_client_receiver_2 = WebsocketClientReceiver(WebsocketObjects=websocket_client_start_2, AutoUpdate=Toggle(True))  # -> Message, Status
websocket_client_sender_2 = WebsocketClientSender(WebsocketObjects=websocket_client_start_2, Message=subscribe_2)
panel_3 = Panel(websocket_client_receiver_2.Message)

websocket_client_start_3 = WebsocketClientStart(Address=panel, InitalMessage="Hello World", Reset=button)
subscribe_3 = Subscribe(Topic="/pose_BaseStation2")  # -> R; same code as subscribe
websocket_client_receiver_3 = WebsocketClientReceiver(WebsocketObjects=websocket_client_start_3, AutoUpdate=Toggle(True))  # -> Message, Status
websocket_client_sender_3 = WebsocketClientSender(WebsocketObjects=websocket_client_start_3, Message=subscribe_3)
panel_4 = Panel(websocket_client_receiver_3.Message)

websocket_client_start_4 = WebsocketClientStart(Address=panel, InitalMessage="Hello World", Reset=button)
subscribe_4 = Subscribe(Topic="/pose_LeftHandController")  # -> R; same code as subscribe
websocket_client_receiver_4 = WebsocketClientReceiver(WebsocketObjects=websocket_client_start_4, AutoUpdate=Toggle(False))  # -> Message, Status
websocket_client_sender_4 = WebsocketClientSender(WebsocketObjects=websocket_client_start_4, Message=subscribe_4)
panel_5 = Panel(websocket_client_receiver_4.Message)

websocket_client_start_5 = WebsocketClientStart(Address=panel, InitalMessage="Hello World", Reset=button)
subscribe_5 = Subscribe(Topic="/pose_RightHandController")  # -> R; same code as subscribe
websocket_client_receiver_5 = WebsocketClientReceiver(WebsocketObjects=websocket_client_start_5, AutoUpdate=Toggle(False))  # -> Message, Status
websocket_client_sender_5 = WebsocketClientSender(WebsocketObjects=websocket_client_start_5, Message=subscribe_5)
panel_6 = Panel(websocket_client_receiver_5.Message)

crv = Curve(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)
divide = DivideCurve(Curve=crv, Count=10, Kinks=False)  # -> Points, Tangents, Parameters
pl = ConstructPlane(Origin=divide.Points, XAxis=divide.Tangents, YAxis="{0,-1,0}")
data = Data("{\"topic\": \"/pose_Tracker\", \"msg\": {\"position\": {\"y\": 0.0011513233184814453, \"x\": 1.0523889064788818, \"z\": 0.731367826461792}, \"orientation\": {\"y\": 0.6496021151542664, \"x\": -0.28966018557548523, \"z\": 0.6410505175590515, \"w\": 0.2883891761302948}}, \"op\": \"publish\"}")
data_2 = Data("{\"topic\": \"/pose_BaseStation1\", \"msg\": {\"position\": {\"y\": -1.7601797580718994, \"x\": 2.7480850219726562, \"z\": 3.207335948944092}, \"orientation\": {\"y\": 0.034134939312934875, \"x\": 0.2738822102546692, \"z\": -0.23833301663398743, \"w\": 0.9311395287513733}}, \"op\": \"publish\"}")
data_3 = Data("{\"topic\": \"/pose_BaseStation2\", \"msg\": {\"position\": {\"y\": 1.6994092464447021, \"x\": 2.2931346893310547, \"z\": 3.307945728302002}, \"orientation\": {\"y\": -0.28203123807907104, \"x\": 0.02893275022506714, \"z\": 0.9163396954536438, \"w\": -0.2827415466308594}}, \"op\": \"publish\"}")
data_4 = Data("{\"topic\": \"/pose_LeftHandController\", \"msg\": {\"position\": {\"y\": -0.1865549087524414, \"x\": 0.9056692123413086, \"z\": 0.7903873920440674}, \"orientation\": {\"y\": 0.11405383050441742, \"x\": 0.05996648222208023, \"z\": 0.7468011975288391, \"w\": -0.6524444222450256}}, \"op\": \"publish\"}")
data_5 = Data("{\"topic\": \"/pose_RightHandController\", \"msg\": {\"position\": {\"y\": -0.19459915161132812, \"x\": 0.9539108276367188, \"z\": 0.7890238761901855}, \"orientation\": {\"y\": 0.11943212151527405, \"x\": 0.04325507581233978, \"z\": 0.8541472554206848, \"w\": -0.5042790770530701}}, \"op\": \"publish\"}")
pln = Plane(pl)
python = GhPythonScript(M=panel_2)  # -> out, X, Y, Z, q1, q2, q3, q4
# ---------- python: Python ----------
import json

try:
    jsonObj = json.loads(M)["msg"];
    
    X = jsonObj["position"]["x"]
    Y = jsonObj["position"]["y"]
    Z = jsonObj["position"]["z"]
    
    q1 = jsonObj["orientation"]["x"]
    q2 = jsonObj["orientation"]["y"]
    q3 = jsonObj["orientation"]["z"]
    q4 = jsonObj["orientation"]["w"]
except:
    X = None
    Y = None
    Z = None
    
    q1 = None
    q2 = None
    q3 = None
    q4 = None
# ---------- end python ----------
python_2 = GhPythonScript(M=panel_3)  # -> out, X, Y, Z, q1, q2, q3, q4; same code as python
python_3 = GhPythonScript(M=panel_4)  # -> out, X, Y, Z, q1, q2, q3, q4; same code as python
python_4 = GhPythonScript(M=panel_5)  # -> out, X, Y, Z, q1, q2, q3, q4; same code as python
python_5 = GhPythonScript(M=panel_6)  # -> out, X, Y, Z, q1, q2, q3, q4; same code as python
pt = ConstructPoint(XCoordinate=python_3.X, YCoordinate=python_3.Y, ZCoordinate=python_3.Z)
quat2trans = QuaternionToTransform(x=python_3.q1, y=python_3.q2, z=python_3.q3, w=python_3.q4)  # -> m
# ---------- quat2trans: Python ----------
from Grasshopper.Kernel.Types import GH_Matrix
from Rhino.Geometry import Transform

m = Transform()

x = (x or 1)
y = (y or 0)
z = (z or 0)
w = (w or 0)

xx2 = 2 * x * x
yy2 = 2 * y * y
zz2 = 2 * z * z
xy2 = 2 * x * y
wz2 = 2 * w * z
zx2 = 2 * z * x
wy2 = 2 * w * y
yz2 = 2 * y * z
wx2 = 2 * w * x



m.M00 = 1. - yy2 - zz2
m.M01 = xy2 - wz2
m.M02 = zx2 + wy2
m.M03 = 0

m.M10 = xy2 + wz2
m.M11 = 1. - xx2 - zz2
m.M12 = yz2 - wx2
m.M13 = 0

m.M20 = zx2 - wy2
m.M21 = yz2 + wx2
m.M22 = 1. - xx2 - yy2
m.M23 = 0

m.M30 = 0
m.M31 = 0
m.M32 = 0
m.M33 = 0
# ---------- end quat2trans ----------
pt_2 = ConstructPoint(XCoordinate=python_4.X, YCoordinate=python_4.Y, ZCoordinate=python_4.Z)
quat2trans_2 = QuaternionToTransform(x=python_4.q1, y=python_4.q2, z=python_4.q3, w=python_4.q4)  # -> m; same code as quat2trans
pt_3 = ConstructPoint(XCoordinate=python_5.X, YCoordinate=python_5.Y, ZCoordinate=python_5.Z)
quat2trans_3 = QuaternionToTransform(x=python_5.q1, y=python_5.q2, z=python_5.q3, w=python_5.q4)  # -> m; same code as quat2trans
pt_4 = ConstructPoint(XCoordinate=python.X, YCoordinate=python.Y, ZCoordinate=python.Z)
quat2trans_4 = QuaternionToTransform(x=python.q1, y=python.q2, z=python.q3, w=python.q4)  # -> m; same code as quat2trans
pt_5 = ConstructPoint(XCoordinate=python_2.X, YCoordinate=python_2.Y, ZCoordinate=python_2.Z)
quat2trans_5 = QuaternionToTransform(x=python_2.q1, y=python_2.q2, z=python_2.q3, w=python_2.q4)  # -> m; same code as quat2trans
xy = XYPlane(Origin=Point(0, 0, 0))
xy_2 = XYPlane(Origin=Point(0, 0, 0))
xy_3 = XYPlane(Origin=Point(0, 0, 0))
xy_4 = XYPlane(Origin=Point(0, 0, 0))
xy_5 = XYPlane(Origin=Point(0, 0, 0))
number_slider = Slider(0.05, range=0..0.1)
number_slider_2 = Slider(0.05, range=0..0.1)

# ---- group: Visualising Robot Joint States / First and Third Values have to be switched!
panel_7 = Panel("""2
1
0
3
4
5""")

# ---- group: Visualising Robot Joint States
websocket_client_start_6 = WebsocketClientStart(Address=panel, InitalMessage="Hello World", Reset=Button())
subscribe_6 = Subscribe(Topic="/joint_states")  # -> R; same code as subscribe
timer_2 = Timer(TimerInterval=1000, Target=websocket_client_receiver_6)
websocket_client_receiver_6 = WebsocketClientReceiver(WebsocketObjects=websocket_client_start_6, AutoUpdate=Toggle(False))  # -> Message, Status
websocket_client_sender_6 = WebsocketClientSender(WebsocketObjects=websocket_client_start_6, Message=subscribe_6)
panel_8 = Panel(websocket_client_receiver_6.Message)
python_6 = GhPythonScript(M=panel_8)  # -> out, values, velocities, names
# ---------- python_6: Python ----------
import json

try:
    jsonObj = json.loads(M)["msg"];
    values = jsonObj["position"]
    speeds = jsonObj["velocity"]
    names = jsonObj["name"]
    a1 = values[0]
    a2 = values[1]
    a3 = values[2]
    a4 = values[3]
    a5 = values[4]
    a6 = values[5]
except:
    a1 = None
    a2 = None
    a3 = None
    a4 = None
    a5 = None
    a6 = None
# ---------- end python_6 ----------
item = ListItem(List=python_6.values, Index=panel_7, Wrap=True)
list = ValueList({"AA-KR60", "AA-KR30", "AA-KR60_KR30", "AARCH IRB120", "AARCH IRB6620", "Bartlett-IRB120", "Bartlett-IRB1600", "Bartlett-KR6", "Bartlett-KR60", "Bartlett-UR10"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}, selected="iaac-UR10e")
join = TextJoin(Text=item, Join=",")
load_robot = LoadRobotSystem(Name=list, Base=PlaneXY(0, 0, 0))
target = CreateTarget(Joints=join, IsCartesian=False)
program = CreateProgram(Name="DefaultProgram", RobotSystem=load_robot, Targets1=target, StepSize=1)  # -> Program, Code, Duration, Warnings, Errors
sim = ProgramSimulation(Program=program.Program, Time=0, Normalized=True)  # -> SystemMeshes, JointRotations, Plane, Index, Time, Program, Errors
scale = Scale(Geometry=sim.SystemMeshes, Center=Point(0, 0, 0), Factor="0.001")  # -> Geometry, Transform
scale_2 = Scale(Geometry=sim.Plane, Center=Point(0, 0, 0), Factor="0.001")  # -> Geometry, Transform
item_2 = ListItem(List=scale_2.Geometry, Index=Slider(7, range=0..7), Wrap=True)
preview = CustomPreview(Geometry=scale.Geometry, Material=ColourSwatch(SwatchColor=RGBA(189, 201, 197, 207)))

# ----
transform = Transform(Geometry=xy, Transform=quat2trans_5)
transform_2 = Transform(Geometry=xy_2, Transform=quat2trans)
transform_3 = Transform(Geometry=xy_3, Transform=quat2trans_2)
transform_4 = Transform(Geometry=xy_4, Transform=quat2trans_3)
transform_5 = Transform(Geometry=xy_5, Transform=quat2trans_4)
move = Move(Geometry=transform, Motion=pt_5)  # -> Geometry, Transform
symdom = SymmetricalDomain(Length=number_slider, Base=0)
move_2 = Move(Geometry=transform_2, Motion=pt)  # -> Geometry, Transform
symdom_2 = SymmetricalDomain(Length=number_slider_2, Base=0)
move_3 = Move(Geometry=transform_3, Motion=pt_2)  # -> Geometry, Transform
move_4 = Move(Geometry=transform_5, Motion=pt_4)  # -> Geometry, Transform
move_5 = Move(Geometry=transform_4, Motion=pt_3)  # -> Geometry, Transform
box = DomainBox(Base=move.Geometry, X=symdom, Y=symdom, Z=number_slider)
box_2 = DomainBox(Base=move_2.Geometry, X=symdom_2, Y=symdom_2, Z=number_slider_2)

# ---- group: twist
pt_6 = ConstructPoint(XCoordinate=Slider(0, range=-1..1), YCoordinate=Slider(0.5, range=-1..1), ZCoordinate=Slider(0.6, range=0..1))
xy_6 = XYPlane(Origin=pt_6)
deplane = DeconstructPlane(Plane=xy_6)  # -> Origin, XAxis, YAxis, ZAxis
rot3d = Rotate3D(Geometry=xy_6, Angle=3.141592654, Center=deplane.Origin, Axis=deplane.XAxis)  # -> Geometry, Transform
list_2 = ValueList({"AA-KR60", "AA-KR30", "AA-KR60_KR30", "AARCH IRB120", "AARCH IRB6620", "Bartlett-IRB120", "Bartlett-IRB1600", "Bartlett-KR6", "Bartlett-KR60", "Bartlett-UR10"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}, selected="iaac-KR150-2_110")
load_robot_2 = LoadRobotSystem(Name=list_2, Base=PlaneXY(0, 0, 0))
ros_topic_types = ROSTopicTypes({"String": "std_msgs/String", "Twist": "geometry_msgs/Twist", "Pose": "geometry_msgs/Pose"}, selected="Twist")
websocket_client_start_7 = WebsocketClientStart(Address="ws://192.168.1.35:9090", InitalMessage="Hello World", Reset=Button())
advertise = Advertise(Topic="/target_plane_twist", Type=ros_topic_types)  # -> R
# ---------- advertise: Python ----------
import json


data = {
"op":"advertise",
"topic":Topic,
"type":Type
}

R = json.dumps(data)
# ---------- end advertise ----------
websocket_client_sender_7 = WebsocketClientSender(WebsocketObjects=websocket_client_start_7, Message=advertise)

# ----
pln_2 = Plane(rot3d.Geometry)

# ---- group: twist (continued)
fromplane = FromPlane(Plane=pln_2, RobotSystem=load_robot_2)
item_3 = ListItem(List=fromplane, Index=0, Wrap=True)  # -> Item, Item1, Item2, Item3, Item4, Item5
publish_twist = PublishTwist(
    topic="/target_plane_twist",
    LX=item_3.Item,
    LY=item_3.Item1,
    LZ=item_3.Item2,
    AX=item_3.Item3,
    AY=item_3.Item4,
    AZ=item_3.Item5)  # -> R
# ---------- publish_twist: Python ----------
import json


data = {
"op":"publish",
"topic":topic,
"msg":{
    "angular":{"x":(AX or 0), "y":(AY or 0), "z":(AZ or 0)},
    "linear":{"x":(LX or 0), "y":(LY or 0), "z":(LZ or 0)},
}
}

R = json.dumps(data)
# ---------- end publish_twist ----------
websocket_client_sender_8 = WebsocketClientSender(WebsocketObjects=websocket_client_start_7, Message=publish_twist)
